# Grasshopper definition bhom_all.gh (Grasshopper 1.0.8)
# plug-ins: BH.UI.Grasshopper, TTLadapter

material = Material(Name="S235", Density=nan, Component="{ .Material")
boxprofile = BoxProfile(Height="0.096", Width="0.100", Thickness="0.008", OuterRadius=0, InnerRadius=0, Component="{ .BoxProfile")
constantframingproperty = ConstantFramingProperty(Profile=boxprofile, Material=material, OrientationAngle=0, Name="Hea100", Component="{ .ConstantFramingProperty")
columns_yard = Point([Point(41.23751446, 21.20152552, 0), Point(54.50277559, 14.38383497, 0), Point(47.87014503, 14.38383497, 0), Point(41.23751446, 14.38383497, 0)])
columns_main_building = Point([Point(67.76803672, 30.38460176, 0), Point(61.13540616, 30.38460176, 0), Point(54.50277559, 30.38460176, 0), Point(47.87014503, 30.38460176, 0), Point(67.76803672, 21.20152552, 0), Point(61.13540616, 21.20152552, 0), Point(54.50277559, 21.20152552, 0), Point(47.87014503, 21.20152552, 0)])
column = Column(BasePoint=columns_yard, Height="0.48", Property=constantframingproperty, Name="yard columns", Component="{ .Column")
column_2 = Column(
    BasePoint=columns_main_building,
    Height="3.75",
    Property=constantframingproperty,
    Name="house columns",
    Component="{ .Column")

# ----
# Read from TTL
# Create an object, convert it to TTL,
# then read the TTL text and convert it
# back to the original object.
panel = Panel("http://someOntology.com")
crv = Curve(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)
room = Room(Perimeter=crv, Name="Test room", Component="BH.oM.Architecture.Elements.Room")
basicgraphsettings = BasicGraphSettings(
    OntologyTitle="someOntology",
    OntologyDescription="someOntology",
    TBoxURI=panel,
    ABoxURI=panel,
    SerializeGeoToBase64=Toggle(False),
    Component="{ .BasicGraphSettings")
tottl = ToTTL(Objects=room, GraphSettings=basicgraphsettings, Component="{ .ToTTL")
panel_2 = Panel(tottl)

# ----
# Custom class generation via CustomObject
number_slider = Slider(3, range=0..10)
pop2d = Populate2D(Region={Plane=PlaneXY(0, 0, 0), Size=Domain2(u=0..20, v=0..10)}, Count=number_slider, Seed=1)
series = Series(Start=0, Step=1, Count=10)
panel_3 = Panel("http://someOntology.com")
createcustom = CreateCustom(Type="SomeCustomType", listOfNumbers=series, listOfPoints=pop2d, Component="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")
basicgraphsettings_2 = BasicGraphSettings(
    OntologyTitle="someOntology",
    OntologyDescription="someOntology",
    TBoxURI=panel_3,
    ABoxURI=panel_3,
    SerializeGeoToBase64=Toggle(True),
    Component="{ .BasicGraphSettings")
tottl_2 = ToTTL(Objects=createcustom, GraphSettings=basicgraphsettings_2, Component="{ .ToTTL")
panel_4 = Panel(tottl_2)

# ----
# Custom Type with Mesh
panel_5 = Panel("Material")
createcustom_2 = CreateCustom(Type=panel_5, MaterialName="Clay", Component="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")
createcustom_3 = CreateCustom(Type=panel_5, MaterialName="Wood", Component="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")
basicgraphsettings_3 = BasicGraphSettings(
    OntologyTitle="asd",
    OntologyDescription="asd",
    TBoxURI="http://asd.com",
    ABoxURI="http://asd.com",
    SerializeGeoToBase64=Toggle(True),
    Component="{ .BasicGraphSettings")
conmesh = ConstructMesh(Vertices=[Point(0, 0, 0), Point(10, 0, 0), Point(10, 10, 0), Point(0, 10, 0)], Faces={A=0, B=1, C=2, D=3})
createcustom_4 = CreateCustom(
    Type="Roof",
    Materials=[createcustom_2, createcustom_3],
    Shape=conmesh,
    TestProperty="TestPropertyValue",
    Component="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")
tottl_3 = ToTTL(Objects=createcustom_4, GraphSettings=basicgraphsettings_3, Component="{ .ToTTL")
explode = Explode(Object=createcustom_4, Component="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")  # -> Type, Materials, Shape, Name, Tags, BHoM_Guid
panel_6 = Panel(explode.Materials)
explode_2 = Explode(Object=explode.Shape, Component="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")  # -> Vertices, Faces
explode_3 = Explode(Object=explode_2.Vertices, Component="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")  # -> X, Y, Z
panel_7 = Panel(explode_3.X)
panel_8 = Panel(tottl_3)
fromttl = FromTTL(TTLtext=panel_8, Component="{ .FromTTL")  # -> KG, OS
explode_4 = Explode(Object=fromttl.OS, Component="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")  # -> OntologyTitle, OntologyDescription, OntologyBaseAddress, TBoxSettings, ABoxSettings
explode_5 = Explode(Component="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")  # -> Vertices, Faces
explode_6 = Explode(Object=explode_5.Vertices, Component="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")  # -> X, Y, Z
panel_9 = Panel(explode_6.X)

connectionsettings = ConnectionSettings(PushPort="14128", PullPort="14129", MaxMinutesToWait=100, Component="{ .ConnectionSettings")
revitsettings = RevitSettings(ConnectionSettings=connectionsettings, DistanceTolerance=1e-06, AngleTolerance=1e-06, Component="{ .RevitSettings")

basicgraphsettings_4 = BasicGraphSettings(
    OntologyTitle="house modernist architecture",
    OntologyDescription="house modernist architecture",
    TBoxURI="https://schema.org",
    ABoxURI="https://individuals.org/",
    SerializeGeoToBase64=Toggle(True),
    Component="{ .BasicGraphSettings")
graphdbadapter = GraphDBAdapter(
    RepositoryName="BHoMGraphDBRepo",
    ServerAddress="http://localhost:7200/",
    GraphName="defaultGraph",
    ClearGraph=False,
    PushTimeoutMillisec=10000,
    GraphSettings=basicgraphsettings_4,
    Activate=Toggle(False),
    Component="{ ..ctor")

circleprofile = CircleProfile(Diameter="0.1", Component="{ .CircleProfile")
material_2 = Material(Name="S235", Density="7850", Component="{ .Material")
constantframingproperty_2 = ConstantFramingProperty(
    Profile=circleprofile,
    Material=material_2,
    OrientationAngle=0,
    Name="Hohlprofil_100",
    Component="{ .ConstantFramingProperty")
columns_yard_2 = Point([Point(41.23751446, 21.20152552, 0), Point(54.50277559, 14.38383497, 0), Point(47.87014503, 14.38383497, 0), Point(41.23751446, 14.38383497, 0)])
columns_main_building_2 = Point([Point(67.76803672, 30.38460176, 0), Point(61.13540616, 30.38460176, 0), Point(54.50277559, 30.38460176, 0), Point(47.87014503, 30.38460176, 0), Point(67.76803672, 21.20152552, 0), Point(61.13540616, 21.20152552, 0), Point(54.50277559, 21.20152552, 0), Point(47.87014503, 21.20152552, 0)])
column_3 = Column(BasePoint=columns_yard_2, Height="0.48", Property=constantframingproperty_2, Name="yard columns", Component="{ .Column")
column_4 = Column(
    BasePoint=columns_main_building_2,
    Height="3.75",
    Property=constantframingproperty_2,
    Name="house columns",
    Component="{ .Column")

construction = Construction(Component="{ .Construction")
floor_main_building = Curve(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)
floor_yard = Curve(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)
floor = Floor(Construction=construction, Edges=floor_main_building, Component="{ .Floor")
floor_2 = Floor(Construction=construction, Edges=floor_yard, Component="{ .Floor")

room_2 = Curve(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)
area = Area(Geometry=room_2)  # -> Area, Centroid
room_3 = Room(Perimeter=room_2, Location=area.Centroid, Name="Main Room", Component="BH.oM.Architecture.Elements.Room")

ceiling = Curve(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)
construction_2 = Construction(Component="BH.oM.Physical.Constructions.Construction")
srf = Surface(ceiling)
ceiling_2 = Ceiling(Surface=srf, Construction=construction_2, Name="Main Room Ceiling", Component="BH.oM.Architecture.Elements.Ceiling")

construction_3 = Construction(Component="{ .Construction")
floor_main_building_2 = Curve(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)
floor_yard_2 = Curve(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)
floor_3 = Floor(Construction=construction_3, Edges=floor_main_building_2, Component="{ .Floor")
floor_4 = Floor(Construction=construction_3, Edges=floor_yard_2, Component="{ .Floor")

ceiling_3 = Curve(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)
construction_4 = Construction(Component="BH.oM.Physical.Constructions.Construction")
srf_2 = Surface(ceiling_3)
ceiling_4 = Ceiling(Surface=srf_2, Construction=construction_4, Name="Main Room Ceiling", Component="BH.oM.Architecture.Elements.Ceiling")

room_4 = Curve(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)
area_2 = Area(Geometry=room_4)  # -> Area, Centroid
room_5 = Room(Perimeter=room_4, Location=area_2.Centroid, Name="Main Room", Component="BH.oM.Architecture.Elements.Room")

architect = CreateCustom(
    Type="Architect",
    Name="Ludwig Mies van der Rohe",
    DateOfBirth="27. March 1886",
    Component="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")
building = CreateCustom(
    Type="Building",
    Name="Farnsworth house",
    YearOfConstruction="1951",
    Site_Location="14520 River Rd, Plano, IL 60545, US",
    Architect=architect,
    Rooms=room_5,
    Floors=[floor_3, floor_4],
    Ceilings=ceiling_4,
    Columns=[column, column_2],
    Component="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")
push = Push(
    Adapter=graphdbadapter,
    Objects=flatten(building),
    PushType="{ \"_t\" : \"System.Enum\", \"TypeName\" : { \"_t\" : \"System.Type\", \"Name\" : \"BH.oM.Adapter.PushType\", \"_bhomVersion\" : \"7.2\" }, \"Value\" : \"AdapterDefault\", \"_bhomVersion\" : \"7.2\" }",
    Active=Toggle(False),
    Component="{ .Push")  # -> Objects, Success
panel_10 = Panel("http://127.0.0.1:5000/")
number_slider_2 = Slider(10000, range=0..10000)
button = Button()
file_path = FilePath("C:\Users\Markus\Documents\Git\GitHub\RDF_componenet\Duplex_A_20110907_LBD_ifcOWL.ttl")
ttladapter = TTLAdapter(Component="{ ..ctor")
ttladapter_2 = TTLadapter(URL="http://localhost:5000", TTL=file_path, Timeout=30000, Send=Toggle(True))
panel_11 = Panel(ttladapter_2)

architect_2 = CreateCustom(Name="Ludwig Mies van der Rohe", DateOfBirth="27. March 1886", Component="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")

construction_5 = Construction(Component="{ .Construction")
floor_yard_3 = Curve(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)
floor_main_building_3 = Curve(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)
floor_5 = Floor(Construction=construction_5, Edges=floor_main_building_3, Component="{ .Floor")
floor_6 = Floor(Construction=construction_5, Edges=floor_yard_3, Component="{ .Floor")

# ---- group: Revit adapter
revitadapter = RevitAdapter(RevitSettings=revitsettings, Active=Toggle(False), Component="{ ..ctor")

# ----
filterbyselectionset = FilterBySelectionSet(SelectionSetName="toRhino", Component="BH.oM.Adapters.Revit.Requests.FilterBySelectionSet")
pull = Pull(
    Adapter=revitadapter,
    Request=filterbyselectionset,
    PullType="{ \"_t\" : \"System.Enum\", \"TypeName\" : { \"_t\" : \"System.Type\", \"Name\" : \"BH.oM.Adapter.PullType\", \"_bhomVersion\" : \"7.2\" }, \"Value\" : \"AdapterDefault\", \"_bhomVersion\" : \"7.2\" }",
    Active=Toggle(False),
    Component="{ .Pull")  # -> simplify(flatten(Objects))

construction_6 = Construction(Component="BH.oM.Physical.Constructions.Construction")
ceiling_5 = Curve(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)
floor_7 = Floor(Construction=construction_6, Edges=ceiling_5, Component="{ .Floor")

room_6 = Curve(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)
area_3 = Area(Geometry=room_6)  # -> Area, Centroid
room_7 = Room(Perimeter=room_6, Location=area_3.Centroid, Name="Main Room", Component="BH.oM.Architecture.Elements.Room")

# ----
# 3. Grasshopper3D to GraphDB
# With the GraphDB Adapter, you can directly upload the created graph file to a local or hosted instance of GraphDB.
# <https://www.OntologyExample.com/BH.oM.Architecture.Elements.Room>
panel_12 = Panel("BHoMOntology")
basicgraphsettings_5 = BasicGraphSettings(
    OntologyTitle=panel_12,
    OntologyDescription="GraphDB examples",
    TBoxURI="https://www.OntologyExample.com",
    ABoxURI="https://www.Individuals.com",
    SerializeGeoToBase64=Toggle(False),
    Component="{ .BasicGraphSettings")
crv_2 = Curve(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)
room_8 = Room(Perimeter=crv_2, Component="BH.oM.Architecture.Elements.Room")
graphdbadapter_2 = GraphDBAdapter(
    RepositoryName="BHoM_to_GraphDB",
    ServerAddress="http://www.localhost:7200/",
    GraphName="defaultGraph",
    ClearGraph=Toggle(False),
    PushTimeoutMillisec=10000,
    GraphSettings=basicgraphsettings_5,
    Activate=Toggle(True),
    Component="{ ..ctor")
push_2 = Push(
    Adapter=graphdbadapter_2,
    Objects=flatten(room_8),
    PushType="{ \"_t\" : \"System.Enum\", \"TypeName\" : { \"_t\" : \"System.Type\", \"Name\" : \"BH.oM.Adapter.PushType\", \"_bhomVersion\" : \"7.2\" }, \"Value\" : \"AdapterDefault\", \"_bhomVersion\" : \"7.2\" }",
    Active=Toggle(True),
    Component="{ .Push")  # -> Objects, Success
panel_13 = Panel(push_2.Objects)
panel_14 = Panel(push_2.Success)
explode_7 = Explode(Object=room_8, Component="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")  # -> Perimeter, Location, BHoM_Guid, Name, Fragments, Tags, CustomData; disabled
number_slider_3 = Slider(3, range=0..10)  # disabled
surface = Surface(explode_7.Perimeter)  # disabled
unit_z = UnitZ(Factor=number_slider_3)  # disabled
extrude = Extrude(Base=surface, Direction=unit_z)  # disabled

basicgraphsettings_6 = BasicGraphSettings(
    OntologyTitle="house modernist architecture",
    OntologyDescription="house modernist architecture",
    TBoxURI="https://schema.org",
    ABoxURI="https://individuals.org/",
    SerializeGeoToBase64=Toggle(True),
    Component="{ .BasicGraphSettings")
toggle = BooleanToggle(True)
graphdbadapter_3 = GraphDBAdapter(
    RepositoryName="BHoMGraphDBRepo",
    ServerAddress="http://localhost:7200/",
    GraphSettings=basicgraphsettings_6,
    Activate=toggle,
    Component="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")

# ----
# 1. Revit to Grasshopper3D
panel_15 = Panel(pull)
bh_iobject = BHIObject(
    pull,
    ObjectType="{ \"_t\" : \"System.Type\", \"Name\" : \"System.Object, System.Private.CoreLib, Version=7.0.0.0, Culture=neutral, PublicKeyToken=7cec85d7bea7798e\", \"_bhomVersion\" : \"7.2\" }",
    m_ForcePreview=False,
    m_MaxItemsPreview=10000)
list_item = ListItem(List=bh_iobject, Index=0, Wrap=True)
explode_8 = Explode(Object=list_item, Component="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")  # -> Location, Construction, Openings, Offset, BHoM_Guid, Name, Fragments, Tags, CustomData
panel_16 = Panel(explode_8.Openings)

# ----
# 2. BHoM to Graph
relay = Relay([architect_2, room_7, floor_7, floor_5, floor_6, column_3, column_4])
data = Data(relay)
basicgraphsettings_7 = BasicGraphSettings(
    OntologyTitle="BHoMOntology",
    OntologyDescription="Ontology example with BHoM and custom objects",
    TBoxURI="https://www.OntologyExample.com",
    ABoxURI="https://www.Individuals.com",
    SerializeGeoToBase64=Toggle(False),
    Component="{ .BasicGraphSettings")
ttladapter_3 = TTLAdapter(GraphSettings=basicgraphsettings_7, Component="{ ..ctor")
push_3 = Push(
    Adapter=ttladapter_3,
    Objects=flatten(data),
    PushType="{ \"_t\" : \"System.Enum\", \"TypeName\" : { \"_t\" : \"System.Type\", \"Name\" : \"BH.oM.Adapter.PushType\", \"_bhomVersion\" : \"7.2\" }, \"Value\" : \"AdapterDefault\", \"_bhomVersion\" : \"7.2\" }",
    Active=Toggle(True),
    Component="{ .Push")  # -> Objects, Success
panel_17 = Panel(push_3.Objects)

fromttl_2 = FromTTL(TTLtext=panel_2, Component="{ .FromTTL")  # -> KG, OS
explode_9 = Explode(Object=fromttl_2.OS, Component="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")  # -> OntologyTitle, OntologyDescription, OntologyBaseAddress, TBoxSettings, ABoxSettings
explode_10 = Explode(Object=fromttl_2.KG, Component="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")  # -> Perimeter, Location, BHoM_Guid, Name, Fragments, Tags, CustomData
panel_18 = Panel(explode_10.Perimeter)
panel_19 = Panel(explode_10.Name)
panel_20 = Panel(explode_9.OntologyDescription)
panel_21 = Panel(explode_9.OntologyTitle)
panel_22 = Panel(explode_10.Location)

fromttl_3 = FromTTL(TTLtext=panel_4, Component="{ .FromTTL")  # -> KG, OS
explode_11 = Explode(Object=fromttl_3.OS, Component="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")  # -> OntologyTitle, OntologyDescription, OntologyBaseAddress, TBoxSettings, ABoxSettings
explode_12 = Explode(Object=fromttl_3.KG, Component="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")  # -> Type, ListOfNumbers, ListOfPoints, Name, Tags, BHoM_Guid
panel_23 = Panel(explode_12.Type)
panel_24 = Panel(explode_11.OntologyDescription)
panel_25 = Panel(explode_11.OntologyTitle)
panel_26 = Panel(explode_12.ListOfNumbers)
panel_27 = Panel(explode_12.ListOfPoints)

columns_yard_3 = Point([Point(41.23751446, 21.20152552, 0), Point(54.50277559, 14.38383497, 0), Point(47.87014503, 14.38383497, 0), Point(41.23751446, 14.38383497, 0)])
columns_main_building_3 = Point([Point(67.76803672, 30.38460176, 0), Point(61.13540616, 30.38460176, 0), Point(54.50277559, 30.38460176, 0), Point(47.87014503, 30.38460176, 0), Point(67.76803672, 21.20152552, 0), Point(61.13540616, 21.20152552, 0), Point(54.50277559, 21.20152552, 0), Point(47.87014503, 21.20152552, 0)])

boxprofile_2 = BoxProfile(Height="0.096", Width="0.100", Thickness="0.008", OuterRadius=0, InnerRadius=0, Component="{ .BoxProfile")
material_3 = Material(Density=nan, Name="S235", Component="BH.oM.Physical.Materials.Material")
architect_3 = CreateCustom(
    Type="Architect",
    Name="Ludwig Mies van der Rohe",
    DateOfBirth="27. March 1886",
    Component="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")
graphdbadapter_4 = GraphDBAdapter(
    RepositoryName="BHoMGraphDBRepo",
    ServerAddress="http://localhost:7200/",
    GraphName="defaultGraph",
    ClearGraph=False,
    PushTimeoutMillisec=10000,
    GraphSettings=basicgraphsettings_6,
    Activate=toggle,
    Component="{ ..ctor")
panel_28 = Panel(graphdbadapter_4)

constantframingproperty_3 = ConstantFramingProperty(Profile=boxprofile_2, Material=material_3, OrientationAngle=0, Name="Hea100", Component="{ .ConstantFramingProperty")
column_5 = Column(BasePoint=columns_yard_3, Height="0.48", Property=constantframingproperty_3, Name="yard columns", Component="{ .Column")
column_6 = Column(
    BasePoint=columns_main_building_3,
    Height="3.75",
    Property=constantframingproperty_3,
    Name="house columns",
    Component="{ .Column")

building_2 = CreateCustom(
    Type="Building",
    Name="Farnsworth house",
    YearOfConstruction="1951",
    Site_Location="14520 River Rd, Plano, IL 60545, US",
    Architect=architect_3,
    Rooms=room_3,
    Floors=[floor, floor_2],
    Ceilings=ceiling_2,
    Columns=[column_5, column_6],
    Component="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")
push_4 = Push(
    Adapter=graphdbadapter_4,
    Objects=flatten(building_2),
    PushType="{ \"_t\" : \"System.Enum\", \"TypeName\" : { \"_t\" : \"System.Type\", \"Name\" : \"BH.oM.Adapter.PushType\", \"_bhomVersion\" : \"7.2\" }, \"Value\" : \"AdapterDefault\", \"_bhomVersion\" : \"7.2\" }",
    Active=Toggle(True),
    Component="{ .Push")  # -> Objects, Success
