# Grasshopper definition DemoFileOctober2024.gh (Grasshopper 1.0.8)
# plug-ins: GraphWebsite, BH.UI.Grasshopper

circleprofile = CircleProfile(Diameter="0.1", Component="{ .CircleProfile")
material = Material(Name="S235", Density="7850", Component="{ .Material")
constantframingproperty = ConstantFramingProperty(
    Profile=circleprofile,
    Material=material,
    OrientationAngle=0,
    Name="Hohlprofil_100",
    Component="{ .ConstantFramingProperty")
columns_yard = Point([Point(41.23751446, 21.20152552, 0), Point(54.50277559, 14.38383497, 0), Point(47.87014503, 14.38383497, 0), Point(41.23751446, 14.38383497, 0)])
columns_main_building = Point([Point(67.76803672, 30.38460176, 0), Point(61.13540616, 30.38460176, 0), Point(54.50277559, 30.38460176, 0), Point(47.87014503, 30.38460176, 0), Point(67.76803672, 21.20152552, 0), Point(61.13540616, 21.20152552, 0), Point(54.50277559, 21.20152552, 0), Point(47.87014503, 21.20152552, 0)])
column = Column(BasePoint=columns_yard, Height="0.48", Property=constantframingproperty, Name="yard columns", Component="{ .Column")
column_2 = Column(
    BasePoint=columns_main_building,
    Height="3.75",
    Property=constantframingproperty,
    Name="house columns",
    Component="{ .Column")

# ----
# Here is what an example of the farnsworth house created by Mies van der Rohe converted to a graph would look like. Custom information like the architect have been created as custom objects, while the basic structure of the building like columns, rooms and slabs were created using object already predefined in BHoM.
# Read me
panel = Panel("Ludwig Mies van der Rohe")
architect = CreateCustom(Name=panel, DateOfBirth="27. March 1886", Component="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")

construction = Construction(Component="{ .Construction")
floor_yard = Curve(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)
floor_main_building = Curve(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)
floor = Floor(Construction=construction, Edges=floor_main_building, Component="{ .Floor")
floor_2 = Floor(Construction=construction, Edges=floor_yard, Component="{ .Floor")

construction_2 = Construction(Component="BH.oM.Physical.Constructions.Construction")
ceiling = Curve(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)
floor_3 = Floor(Construction=construction_2, Edges=ceiling, Component="{ .Floor")

room = Curve(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)
area = Area(Geometry=room)  # -> Area, Centroid
room_2 = Room(Perimeter=room, Location=area.Centroid, Name="Main Room", Component="BH.oM.Architecture.Elements.Room")

relay = Relay([architect, room_2, floor_3, floor, floor_2, column, column_2])
basicgraphsettings = BasicGraphSettings(
    OntologyTitle="BHoMOntology",
    OntologyDescription="GraphDB examples",
    TBoxURI="https://www.OntologyExample.com",
    ABoxURI="https://www.Individuals.com",
    SerializeGeoToBase64=Toggle(False),
    Component="{ .BasicGraphSettings")

# ----
# Toggle me!
toggle = BooleanToggle(True)

graphdbadapter = GraphDBAdapter(
    RepositoryName="BHoM_to_GraphDB",
    ServerAddress="http://www.localhost:7200/",
    GraphName="defaultGraph",
    ClearGraph=Toggle(False),
    PushTimeoutMillisec=10000,
    GraphSettings=basicgraphsettings,
    Activate=toggle,
    Component="{ ..ctor")

# ----
# Toggle me!
toggle_2 = BooleanToggle(True)

push = Push(
    Adapter=graphdbadapter,
    Objects=flatten(relay),
    PushType="{ \"_t\" : \"System.Enum\", \"TypeName\" : { \"_t\" : \"System.Type\", \"Name\" : \"BH.oM.Adapter.PushType\", \"_bhomVersion\" : \"7.2\" }, \"Value\" : \"AdapterDefault\", \"_bhomVersion\" : \"7.2\" }",
    Active=toggle_2,
    Component="{ .Push")  # -> Objects, Success
graphwebsite = GraphWebsite(Credentials=Toggle(False), RunGraphWebsite=Toggle(False))
